# Grasshopper definition 1.1列表List.gh (Grasshopper 1.0.7)

number_slider = Slider(100, range=0..100)
panel = Panel("索引")
panel_2 = Panel("""使用了for循环建立索引
只能建立列表索引值""")
panel_3 = Panel("分片")
panel_4 = Panel("列表基本操作")
neg = Negative(Value=number_slider)
panel_5 = Panel("""gh节点可视化编程不需太关注语法但是复杂时变得特别难读
结合Python来处理，让程序简单""")
dom = ConstructDomain(DomainStart=neg, DomainEnd=number_slider)

# ---- group: 提取数据
python = GhPythonScript(x=Slider(1, range=0..10), y=Slider(4, range=0..10))  # -> out, rectangle, dpoints, dpointe, dpointx, spheres, cube; inputs x: Int32, y: Int32
# ---------- python: Python ----------
__author__ = "billpower"
__version__ = "2019.12.25"

import rhinoscriptsyntax as rs

plane = rs.WorldXYPlane()   #获取xy以原点为中心的参考平面
rectangle = rs.AddRectangle(plane,40,40)

dpointsCoordinate = rs.DivideCurve(rectangle,10) #等分10矩形
dpoints = rs.AddPoints(dpointsCoordinate)   #增加等分点
print(dpoints)

format = "point_%s" #格式化字符串的模式
dpointe = []
i = 0
for i in  range(len(dpoints)):
    dpointe.append(format % str(i)) #格式化字符串并逐一追加到列表
print(dpointe)

dpointx = list(range(len(dpoints))) #建立等分点索引
print(dpointx)

#切片索引，建球
selepoints = dpoints[x:y]
spheres = []
print(selepoints)
for i in range(len(selepoints)):
    sphere = rs.AddSphere(selepoints[i],3)  #提取[y](圆心，半径)
    cube = rs.AddBox(rs.BoundingBox(sphere))    #（物体，plane）
    spheres.append(cube)
#    id = rs.GetObject(sphere)
#    if id: rs.DeleteObject()

print(spheres)
# ---------- end python ----------

# ---- group: 数据切片
python_2 = GhPythonScript()  # -> out, a
# ---------- python_2: Python ----------
__author__ = "billpower"
__version__ = "2019.12.25"

import rhinoscriptsyntax as rs

number = list(range(10))
print(number)

a = number[3:6]
print(a)

b = number[-5:-1]
print(b)

c = number[4:]
print(c)
# ---------- end python_2 ----------

# ---- group: 构建矩形加入索引
python_3 = GhPythonScript()  # -> out, rectangle, dpoints, dpointe, dpointx
# ---------- python_3: Python ----------
__author__ = "billpower"
__version__ = "2019.12.25"

import rhinoscriptsyntax as rs

plane = rs.WorldXYPlane()   #获取xy以原点为中心的参考平面
rectangle = rs.AddRectangle(plane,40,40)

dpointsCoordinate = rs.DivideCurve(rectangle,10) #等分10矩形
dpoints = rs.AddPoints(dpointsCoordinate)   #增加等分点
print(dpoints)

format = "point_%s" #格式化字符串的模式
dpointe = []
i = 0
for i in  range(len(dpoints)):
    dpointe.append(format % str(i)) #格式化字符串并逐一追加到列表
print(dpointe)

dpointx = list(range(len(dpoints))) #建立等分点索引
print(dpointx)
# ---------- end python_3 ----------

# ----
pt = Point(python_3.dpoints)
rectangle = Rectangle(Plane=PlaneXY(0, 0, 0), XSize=dom, YSize=dom, Radius=0)  # -> Rectangle, Length
item = ListItem(List=pt, Index=Slider(2, range=0..10), Wrap=True)
brep = Brep(python.spheres)
divide = DivideCurve(Curve=rectangle.Rectangle, Count="10", Kinks=False)  # -> Points, Tangents, Parameters
panel_6 = Panel(brep)
box = CenterBox(Base=item, X=1, Y=1, Z=1)
python_4 = GhPythonScript(List=divide.Points)  # -> out, DataOut, dpoints; inputs List: list
# ---------- python_4: Python ----------
__author__ = "billpower"
__version__ = "2019.12.24"

import rhinoscriptsyntax as rs

dpoints = List  #定义来源数据
dpointx = list(range(len(dpoints))) #建立数据索引列表

DataOut = List  #输出源数据
dpointx = dpointx   #输出索引

print(dpointx)  #输出数据检查
print(dpoints)
# ---------- end python_4 ----------
panel_7 = Panel(python_4.DataOut)
