# Grasshopper definition 3树形数据和字典.gh (Grasshopper 1.0.7)

pt = Point(Point(-10.21179238, 13.19054344, 0))
number_slider = Slider(6, range=0..10)
xy = XYPlane(Origin=pt)
sqgrid = Square(Plane=xy, Size=Slider(11, range=0..100), ExtentX=number_slider, ExtentY=number_slider)  # -> Cells, Points
area = Area(Geometry=sqgrid.Cells)  # -> Area, Centroid
path = DataPath(Slider(2, range=0..10))
number_slider_2 = Slider(5, range=0..10)
flip = FlipMatrix(Data=area.Centroid)  # -> simplify(Data)
branch = TreeBranch(Tree=flip, Path=path, MaintainPaths=True)
viewer = ParamViewer(flip)
points = PointList(Points=flip, Size=Slider(4, range=0..10))
rectangle = Rectangle(Plane=branch, XSize=number_slider_2, YSize=number_slider_2, Radius=0)  # -> Rectangle, Length
