# Grasshopper definition 4_2字符串至地形.gh (Grasshopper 1.0.7)

panel = Panel("字符串坐标点输入建立网格地形")
path = FilePath("G:\architecture\DigitalDesign\面向建筑师的编程设计\GhPython\地形数据.txt")
path_2 = FilePath("G:\architecture\DigitalDesign\面向建筑师的编程设计\GhPython\地形数据.txt")
pt = Point(Point(-1700.216279, -122.087833, 0))
file = ReadFile(File=path, PerLineParse=True)

# ---- group: 坐标点txt输入，处理成点
python = GhPythonScript(File=path_2, LocationPoint=pt)  # -> out, z, xyz, orpoint, rexyz, repoint
# ---------- python: Python ----------
__author__ = "billpower"
__version__ = "2020.01.15"

import rhinoscriptsyntax as rs

point = LocationPoint
file = File
x = []
y = []
z = []
xyz = []
rexyz = []
repoint = []
orpoint = []
f = open(file,'r')  #使用open打开文件，r为只读模式
firstpoint = f.readline()   #使用方法读取行，读到第一个换行符
subdistance = rs.PointSubtract(rs.AddPoint(firstpoint),point)   #读取第一个行点坐标，建立点并与输入的定位点差，获取两点之间坐标的插值
for line in f.readlines():  #对文件内容进行迭代，读取所有行
    lst = line.split(',')
    x.append(float(lst[0]))
    y.append(float(lst[1]))
    z.append(float(lst[2]))
    xyz.append((float(lst[0]),float(lst[1]),float(lst[2])))     #字符串坐标浮点数化，形成坐标值列表
    orpoint.append(rs.AddPoint(float(lst[0]),float(lst[1]),float(lst[2])))  #根据原数据值建立点
    rexyz.append(((float(lst[0])-subdistance[0]),(float(lst[1])-subdistance[1]),(float(lst[2])-subdistance[2])))    #计算新坐标，形成列表
    repoint.append(rs.AddPoint((float(lst[0])-subdistance[0]),(float(lst[1])-subdistance[1]),(float(lst[2])-subdistance[2])))   #根据新坐标增加点
f.close()   #关闭文件
# ---------- end python ----------

# ----
panel_2 = Panel(path)
split = TextSplit(Text=file, Separators=",")
pt_2 = Point(python.repoint)
data = Data(python.z)

# ---- group: 最低点
sort = SortList(Keys=data, ValuesA=pt_2)  # -> Keys, ValuesA
item = ListItem(List=sort.ValuesA, Index=Slider(0, range=0..100), Wrap=True)

# ----
num2pt = NumbersToPoints(Numbers=split, Mask=4)  # -> flatten(Points)
del = DelaunayMesh(Points=pt_2, Plane=PlaneXY(0, 0, 0))
bnd = Bounds(Numbers=data)
div = DivideDomain(Domain=bnd, Count=6)
dedomain = DeconstructDomain(Domain=div)  # -> Start, End
python_2 = GhPythonScript(dataZ=data, Classification=dedomain.End)  # -> out, clalist; inputs dataZ: list, Classification: list
# ---------- python_2: Python ----------
__author__ = "billpower"
__version__ = "2020.01.15"

import rhinoscriptsyntax as rs

data = dataZ    #z输入带处理数据
cal = Classification    #区间值
da = []
#浮点数化
for j in data:
    da.append(float(j)) #将转化后的值追加到列表中
data = da
for i in cal:
    cal[cal.index(i)] = float(i)
#归纳为a值
for k in range(len(cal)-1):
    a = cal[k]  #获取区间a-b
    b = cal[k+1]
    for q in range(len(data)):
        if a<=data[q]<b:
            data[q] = a     #若z值如果位于a-b分类区间，则用a替换
#两端的数据总结成cal
for w in range(len(data)):
    if data[w] >= cal[-1]:
        data[w] = cal[-1]
    elif data[w] <= cal[0]:
        data[w] = cal[0]
clalist = data
# ---------- end python_2 ----------
del_2 = DelaunayMesh(Points=num2pt, Plane=PlaneXY(0, 0, 0))
del_3 = DelaunayMesh(Points=pt_2, Plane=PlaneXY(0, 0, 0))
dedomain_2 = DeconstructDomain(Domain=bnd)  # -> Start, End
bnd_2 = Bounds(Numbers=python_2.clalist)
gradient = Gradient(
    LowerLimit=dedomain_2.Start,
    UpperLimit=dedomain_2.End,
    Parameter=data,
    stops=[0: RGB(234, 38, 0), 0.25: RGB(234, 126, 0), 0.5: RGB(254, 244, 84), 0.75: RGB(173, 203, 249), 1: RGB(75, 107, 169)])
contour = Contour(Shape=del, Point=item, Direction=Vector(0, 0, 1), Distance=Slider(6, range=0..10))
preview = CustomPreview(Geometry=del_2, Material=ColourSwatch(SwatchColor=RGB(163, 163, 163)))
dedomain_3 = DeconstructDomain(Domain=bnd_2)  # -> Start, End
panel_3 = Panel(num2pt)
gradient_2 = Gradient(
    LowerLimit=dedomain_3.Start,
    UpperLimit=dedomain_3.End,
    Parameter=python_2.clalist,
    stops=[0: RGB(255, 255, 255), 0.858: RGB(0, 0, 0)])
preview_2 = CustomPreview(Geometry=contour, Material=ColourSwatch(SwatchColor=RGB(0, 0, 0)))
mspray = MeshSpray(Mesh=del, Points=pt_2, Colours=reverse(gradient), SprayMode=11)
mcol = MeshColours(Mesh=del_3, Colours=reverse(gradient_2))
